% Simulink data dictionary neck_mk3.sldd

MCU_Ts = 0.001

Data_JointReferences = Simulink.Bus()
  SetPoints: single[3], Unit="deg"  % Setpoints that the system needs to track.

Physical_MotorRotationals = Simulink.ConnectionBus()
  Motor1: Connection: foundation.mechanical.rotational.rotational
  Motor2: Connection: foundation.mechanical.rotational.rotational
  Motor3: Connection: foundation.mechanical.rotational.rotational
  Reference: Connection: foundation.mechanical.rotational.rotational

Physical_MotorPhases = Simulink.ConnectionBus()
  Phase1_Pos: Connection: foundation.electrical.electrical
  Phase2_Pos: Connection: foundation.electrical.electrical
  Phase3_Pos: Connection: foundation.electrical.electrical
  Phase_Neg: Connection: foundation.electrical.electrical

Physical_Environment = Simulink.ConnectionBus()
  World: Connection: simmechanics.connections.frame

Physical_TransmissionRotationals = Simulink.ConnectionBus()
  Transmission1_Stage1: Connection: foundation.mechanical.rotational.rotational
  Transmission1_Stage2: Connection: foundation.mechanical.rotational.rotational
  Transmission2_Stage1: Connection: foundation.mechanical.rotational.rotational
  Transmission2_Stage2: Connection: foundation.mechanical.rotational.rotational
  Transmission3_Stage1: Connection: foundation.mechanical.rotational.rotational
  Transmission3_Stage2: Connection: foundation.mechanical.rotational.rotational
  Reference: Connection: foundation.mechanical.rotational.rotational

Selector_SignalProcessing = Simulink.Parameter(Types_SignalProcessing.None, DataType="Enum: Types_SignalProcessing")
Selector_Planner = Simulink.Parameter(Types_Planner.MinJerk, DataType="Enum: Types_Planner")

Physical_MotorTranslationals = Simulink.ConnectionBus()
  Motor1: Connection: foundation.mechanical.translational.translational
  Motor2: Connection: foundation.mechanical.translational.translational
  Motor3: Connection: foundation.mechanical.translational.translational
  Reference: Connection: foundation.mechanical.translational.translational

Physical_TransmissionTranslationals = Simulink.ConnectionBus()
  Transmission1_Stage1: Connection: foundation.mechanical.translational.translational
  Transmission1_Stage2: Connection: foundation.mechanical.translational.translational
  Transmission2_Stage1: Connection: foundation.mechanical.translational.translational
  Transmission2_Stage2: Connection: foundation.mechanical.translational.translational
  Transmission3_Stage1: Connection: foundation.mechanical.translational.translational
  Transmission3_Stage2: Connection: foundation.mechanical.translational.translational
  Reference: Connection: foundation.mechanical.translational.translational

Physical_Actuation = Simulink.ConnectionBus()
  Motor_Rotationals: Bus: Physical_MotorRotationals
  Motor_Translationals: Bus: Physical_MotorTranslationals
  Transmission_Rotationals: Bus: Physical_TransmissionRotationals
  Transmission_Translationals: Bus: Physical_TransmissionTranslationals

Physical_Multibody = Simulink.ConnectionBus()
  Payload_base_frame: Connection: simmechanics.connections.frame
  Joint1_B: Connection: simmechanics.connections.frame
  Joint1_F: Connection: simmechanics.connections.frame
  Joint2_B: Connection: simmechanics.connections.frame
  Joint2_F: Connection: simmechanics.connections.frame
  Joint3_B: Connection: simmechanics.connections.frame
  Joint3_F: Connection: simmechanics.connections.frame

Data_ControlFeedback = Simulink.Bus()
  Encoders: single[3], Unit="deg"
  Velocities: single[3], Unit="deg/s"
  Currents: single[3], Unit="A"

Req_DOF_Bounds = Simulink.Parameter([-45 22; -20 20; -45 45], Unit="deg")  % Minimum and maximum bounds of the DOFs.
  % The order is PRY.

Req_Control_SettlingTime = Simulink.Parameter(2, Unit="s")  % Required settling time.

Data_Measurements = Simulink.Bus()
  Encoders: single[3], Unit="deg"
  Currents: single[3], Unit="A"
  Power: single[3], Unit="W"
  Torques_Motor: single[3], Unit="mN*m"
  Velocities_Motor: single[3], Unit="rpm"
  Torques_Transmission: single[3], Unit="N*m"
  Velocities_Transmission: single[3], Unit="rpm"
  Payload_orientation: single[4], Unit="1"  % Quaternion

Data_Assertions = Simulink.Bus()
  Motor_Currents: boolean[3]
  Motor_Torques: boolean[3]
  Motor_Velocities: boolean[3]
  Transmission_Torques: boolean[3]
  Transmission_Velocities: boolean[3]

Req_Caps_Motor_Currents = Simulink.Parameter([Inf; Inf; Inf], Unit="A")  % Thresholds that the mechanism shall not exceed while operating at its maximum performance.
  % Tests will set specific values.

Req_Caps_Motor_Torques = Simulink.Parameter([Inf; Inf; Inf], Unit="mN*m")  % Thresholds that the mechanism shall not exceed while operating at its maximum performance.
  % Tests will set specific values.

Req_Caps_Motor_Velocity = Simulink.Parameter([Inf; Inf; Inf], Unit="rpm")  % Thresholds that the mechanism shall not exceed while operating at its maximum performance.
  % Tests will set specific values.

Req_Caps_Transmission_Torques = Simulink.Parameter([Inf; Inf; Inf], Unit="N*m")  % Thresholds that the mechanism shall not exceed while operating at its maximum performance.
  % These values refer to the output shaft.
  % Tests will set specific values.

Req_Caps_Transmission_Velocity = Simulink.Parameter([Inf; Inf; Inf], Unit="rpm")  % Thresholds that the mechanism shall not exceed while operating at its maximum performance.
  % These values refer to the output shaft.
  % Tests will set specific values.

Selector_Controller = Simulink.Parameter(Types_Controller.Mk3_Serial, DataType="Enum: Types_Controller")
Selector_Mechanism = Simulink.Parameter(Types_Mechanism.Mk3_Serial, DataType="Enum: Types_Mechanism")
Selector_Motor = Simulink.Parameter(Types_Motor.DCEquivalent_Faulhaber_Variant1, DataType="Enum: Types_Motor")
Selector_MotorDriver = Simulink.Parameter(Types_MotorDriver.DC_Ideal_24V, DataType="Enum: Types_MotorDriver")
Selector_Sensing = Simulink.Parameter(Types_Sensing.Mk3_Serial, DataType="Enum: Types_Sensing")
Selector_Transmission = Simulink.Parameter(Types_Transmission.Mk3_Serial, DataType="Enum: Types_Transmission")
Selector_Impairments = Simulink.Parameter(Types_Impairments.Ideal, DataType="Enum: Types_Impairments")

Data_ControlCommands = Simulink.Bus()
  Voltage: single[3], Min=-100, Max=100, Unit="%"  % Actuation voltage signals.
  Currents: single[3], Unit="A"  % Current setpoints signals.
  Velocities: single[3], Unit="deg/s"  % Velocity setpoints signals.

Param_SigProcessing_SpeedMeas_Delays = Simulink.Parameter(4, Min=1, Unit="1")
Req_Velocity_Avg = Simulink.Parameter([80; 80; 80], Min=0, Unit="deg/s")  % Reachable average velocity during a minimum-jerk movement.
Req_Velocity_Peak = Simulink.Parameter([120; 120; 120], Min=0, Unit="deg/s")  % Reachable maximum velocity during a minimum-jerk movement.
Param_Planner_MinJerk_ReactionTime = Simulink.Parameter([0.8; 0.4; 1], DataType="single", Min=0, Unit="s")  % Planner reaction time.
Variants = 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
Selector_Payload = Simulink.Parameter(Types_Payload.ergoCubHead, DataType="Enum: Types_Payload")

Data_Disturbances = Simulink.Bus()
  accelerations: double[3], Unit="m/s^2"

Selector_Disturbances = Simulink.Parameter(Types_Disturbances.None, DataType="Enum: Types_Disturbances")
Param_ExternalDisturbances_AccelerationPeriod = Simulink.Parameter([0.06; 0.06; 0.06], Unit="s")
Param_ExternalDisturbances_MaxAcceleration = Simulink.Parameter([2; 2; 3], Unit="1")  % The number of g.
MCU_Ts_FOC = 5.0e-5